# Grasshopper definition pix2grasshopper.gh (Grasshopper 1.0.8)
# plug-ins: RhinoCodePluginGH

# ---- group: Main pix2grasshopper Component
json_path = Panel("")
image_path = Panel("")
openai_api_key = Panel("")
pix2grasshopper = Python3Script(json_path=json_path, img_path=image_path, my_key=openai_api_key)  # -> out, a; inputs json_path: String, img_path: String, my_key: String
# ---------- pix2grasshopper: Python ----------
# requirements: openai
# requirements: torch
# requirements: pillow
# requirements: git+https://github.com/openai/CLIP.git
import json
from openai import OpenAI
import os
import torch
import clip
from PIL import Image
import os

client = OpenAI(api_key=my_key)


device = "cuda" if torch.cuda.is_available() else "cpu"
model, preprocess = clip.load("ViT-B/32", device=device)

def load_descriptions(file_path):
    with open(file_path, 'r') as f:
        data = json.load(f)
        descriptions = []
        tokens = []
        for category, desc_list in data.items():
            descriptions.extend(desc_list)
            tokens.extend([category] * len(desc_list))
    return descriptions, tokens

def get_image_description(image_path, descriptions):
    image = preprocess(Image.open(image_path)).unsqueeze(0).to(device)
    text_inputs = clip.tokenize(descriptions).to(device)

    with torch.no_grad():
        image_features = model.encode_image(image)
        text_features = model.encode_text(text_inputs)

        similarities = (image_features @ text_features.T).softmax(dim=-1)
        best_match_idx = similarities.argmax().item()
        return descriptions[best_match_idx]

def generate_python_code(description):
    prompt = (
        f"Convert the following description into Python code using RhinoScriptSyntax "
        f"for Rhino in Grasshopper, suitable for a GHPython component: {description}. "
        f"Make sure to include calls to the functions made in the script at the end of code and makes sure to outupts the geometry through the 'a' variable."
        f"Try to make the output gemoetrya  3D form, with patterns extending into all 3 dimensions (X,Y,Z)."
        f"Do not include introductory or explanation text, simply give me the code. Remove  the ```python formatting at the begining and end of the code block, just return the code."
    )

    try:
        response = client.chat.completions.create(
            model="gpt-4o",
        messages=[
            {"role": "system", "content": "You are an expert in Rhino and Grasshopper scripting."},
            {"role": "user", "content": prompt}
        ],
        max_tokens=700,
        temperature=0.2
        )
        python_code = response.choices[0].message.content.strip()
    except Exception as e:
        print(f"Error generating Python code: {e}")
        return None

    return python_code

def process_image(image_path):
    descriptions, tokens = load_descriptions(json_path)

    description = get_image_description(image_path, descriptions)
    print(f"Description generated by CLIP: {description}")

    python_code = generate_python_code(description)
    print(f"Generated Python Code:\n{python_code}")

    return python_code


if __name__ == "__main__":
    image_path = img_path
    generated_code = process_image(image_path)
    a = generated_code
# ---------- end pix2grasshopper ----------

# ----
generated_code = Panel(pix2grasshopper.a)
script = Script(Script=pix2grasshopper.a)  # -> Out, A
generated_geometry = Panel(script.A)
geometry = Geometry(script.A)

# ---- group: Debugging Components
script_2 = Script()  # -> out, a; inputs code_string: String; disabled
# ---------- script_2: Python ----------
import traceback
import rhinoscriptsyntax as rs
import math
import random

def run_generated_code(code_string):
    # Define a local namespace for exec
    local_scope = {}
    
    try:
        # Execute code within the provided local_scope dictionary
        exec(code_string, globals(), local_scope)
        
        # Capture the 'a' variable if it exists in the local_scope
        result = local_scope.get("a")
        return result
    except Exception as e:
        error_msg = f"Error executing generated code: {traceback.format_exc()}"
        return error_msg

# Assuming code_string is passed in as an input to this component
output = run_generated_code(code_string)
print(output)
# ---------- end script_2 ----------
python_3_script = Python3Script()  # -> out, a
geometry_2 = Geometry(python_3_script.a)
